# Grasshopper definition 250115_voronoi_words.gh (Grasshopper 1.0.8)

origin_point = Point(Point(8, 5, 0))
bool_make_it_bold = Boolean(True)
# See: https://www.giuliopiacentino.com/grasshopper-tools/
text_script_c = CSharpScript(face="Verdana", bold=bool_make_it_bold, size=Slider(6.026, range=0..11), content="PTWD", pl=origin_point)  # -> out, A; inputs face: String, bold: Boolean, italics: Boolean, size: Double, content: String, pl: Plane
# ---------- text_script_c: C# ----------
    if(size == 0)
      size = 1;

    if(!string.IsNullOrEmpty(face) && size > 0 && !string.IsNullOrEmpty(content) &&
      pl.IsValid)
    {

      var te = RhinoDoc.ActiveDoc.Objects.AddText(content, pl, size, face, bold, italics);
      Rhino.DocObjects.TextObject txt = RhinoDoc.ActiveDoc.Objects.Find(te) as Rhino.DocObjects.TextObject;

      if(txt != null)
      {
        var tt = txt.Geometry as Rhino.Geometry.TextEntity;
        A = tt.Explode();
      }
      
      RhinoDoc.ActiveDoc.Objects.Delete(te, true);
    }
# ---------- end text_script_c ----------
letter_curves = Curve(text_script_c.A)
bounding_box = BoundingBox(Content=letter_curves, Plane=PlaneXY(0, 0, 0), UnionBox=True)  # -> Box, Box_2
value_list = ValueList({"Control Points": 0, "Curve Points": 1}, selected="Curve Points")
control_points = ControlPoints(Curve=letter_curves)  # -> flatten(Points), Weights, Knots
divide_curve = DivideCurve(Curve=letter_curves, Count=Slider(23, range=1..100), Kinks=False)  # -> flatten(Points), Tangents, Parameters
deconstruct_brep = DeconstructBrep(Brep=bounding_box.Box)  # -> Faces, Edges, Vertices
stream_filter = StreamFilter(Gate=value_list, Stream0=control_points.Points, Stream1=divide_curve.Points)
join_curves = JoinCurves(Curves=deconstruct_brep.Edges, Preserve=False)
cull_duplicates = CullDuplicates(Points=stream_filter, Tolerance=".001", CullMode=3)  # -> Points, Indices, Valence
offset_curve = OffsetCurve(Curve=join_curves, Distance=Slider(5.5, range=0..100), Corners=1)
unit_z = UnitZ(Factor="-1.5")
unit_z_2 = UnitZ(Factor="-5.0")
voronoi = Voronoi(Points=cull_duplicates.Points, Radius=Slider(3.6, range=0..100), Boundary=offset_curve, BruteForceOverride=False)
extrude = Extrude(Base=voronoi, Direction=unit_z)
extrude_2 = Extrude(Base=letter_curves, Direction=unit_z_2)
panel = Panel(voronoi)
custom_preview = CustomPreview(Geometry=extrude, Material=ColourSwatch(SwatchColor=RGB(0, 0, 0)))
custom_preview_2 = CustomPreview(Geometry=extrude_2, Material=ColourSwatch(SwatchColor=RGBA(0, 0, 255, 250)))
