# Grasshopper definition PTWD_RhGrPy_Demo.gh (Grasshopper 1.0.8)
# plug-ins: RhinoCodePluginGH, PTComponentLibrary

button = Button()  # disabled
inumber = Slider(5, range=1..20)
jdistance = Slider(20, range=1..100)
jnumber = Slider(4, range=1..20)
idistance = Slider(18, range=1..100)

# ----
# Attractor Point
number_slider = Slider(0, range=0..1)
# Use Python To Get Inputs From the Web
number_slider_2 = Slider(0.2, range=0..1)
multiplication = Multiplication(A=idistance, B=inumber, C=number_slider)
multiplication_2 = Multiplication(A=jdistance, B=jnumber, C=number_slider_2)
construct_point = ConstructPoint(XCoordinate=multiplication, YCoordinate=multiplication_2, ZCoordinate=0)

# ----
# Create grid of solids that react to Attractor Point
# * Note the converging tree data structures that set multiple heights
xy_plane = XYPlane(Origin=Point(0, 0, 0))
# Create 2D Grid of Solids
# * show tree data converging with single value data
number_slider_3 = Slider(10, range=1..100)
python_get_data = Python3Script(start=button)  # -> out, Name, xCount, yCount, xSize, ySize; disabled
# ---------- python_get_data: Python ----------
import requests

if (start == True):
    raise Exception("Filtering button down")

response = requests.get('https://docs.google.com/spreadsheet/ccc?key=19eNQK4_g2zFphqAGZppiMC2N9T-tkiaUlJT5rJNc8WQ&output=csv')
assert response.status_code == 200, 'Wrong status code'
csvData = response.content.decode("utf-8")
print(f"{csvData=}")


#Google sheet submission data:
# https://docs.google.com/spreadsheets/d/19eNQK4_g2zFphqAGZppiMC2N9T-tkiaUlJT5rJNc8WQ/edit?resourcekey=&gid=513826480#gid=513826480
# https://docs.google.com/spreadsheets/d/19eNQK4_g2zFphqAGZppiMC2N9T-tkiaUlJT5rJNc8WQ/edit?usp=sharing

#Form Link:
# https://forms.gle/QuGocdrfk5ZjaKfi8

#CSV Contents:
#Timestamp,Name,X Count,X Unit Size,Y Count,Y Unit Size
#1/11/2025 20:56:56,Jon,10,10,2,8

#Remove all \r's

csvData = csvData.replace("\r", "")

csvLines = csvData.split("\n")

keys = csvLines[0].split(",")

latestValues = csvLines[-1].split(",")

print(f"{keys=}")
print(f"{latestValues=}")


csvDict = dict(zip(keys, latestValues))

for key, value in csvDict.items():
    if key in locals():
        print(f"storing ({key}, {value})")
        locals()[key] = value
    else:
        print(f"locals does not contain: {key}")


# Name = "PTWD Wednesday!!!"
# xCount = 15
# yCount = 15
# xSize = 10
# ySize = 10
# ---------- end python_get_data ----------
columnx = Slider(5, range=1..20)  # disabled
columny = Slider(4, range=1..20)  # disabled
unit_x = UnitX(Factor=1)
unit_y = UnitY(Factor=1)
number_slider_4 = Slider(2, range=1..20)  # disabled
number_slider_5 = Slider(2, range=1..20)  # disabled
panel = Panel(python_get_data.yCount)  # disabled
panel_2 = Panel(python_get_data.ySize)  # disabled
panel_3 = Panel(python_get_data.xCount)  # disabled
panel_4 = Panel(python_get_data.xSize)  # disabled

# ----
# Attractor Point
x_attractor = Slider(0.9, range=0..1)  # disabled
y_attractor = Slider(0.1, range=0..1)  # disabled
multiplication_3 = Multiplication(A=panel_4, B=panel_3, C=x_attractor)  # disabled
multiplication_4 = Multiplication(A=panel_2, B=panel, C=y_attractor)  # disabled
construct_point_2 = ConstructPoint(XCoordinate=multiplication_3, YCoordinate=multiplication_4, ZCoordinate=0)  # disabled

panel_5 = Panel("120")  # disabled
panel_6 = Panel(python_get_data.Name)  # disabled
xy_plane_2 = XYPlane(Origin=Point(0, 0, 0))  # disabled
# PTWD Rhino/Grasshopper/Python Talk
# To Navigate this doc, start at the top. Right click selected elements to re-enable and preview them as necessary
# Very basic single solid generator
# * show Rhino curve referencing and “internalizing of parameters”
human_drawn_closed_curve = Curve(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)  # disabled
juiceman_outline = Curve(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)  # disabled
unit_z = UnitZ(Factor=panel_5)  # disabled
planar_grid = PlanarGrid(
    BasePoint=Point(0, 0, 0),
    IDir=Vector(1, 0, 0),
    JDir=Vector(0, 1, 0),
    IDistance=number_slider_3,
    JDistance=Slider(5, range=1..100),
    INumber=Slider(7, range=1..20),
    JNumber=Slider(10, range=1..20))
planar_grid_2 = PlanarGrid(BasePoint=xy_plane, IDir=unit_y, JDir=unit_x, IDistance=idistance, JDistance=jdistance, INumber=inumber, JNumber=jnumber)
panel_7 = Panel(python_get_data.out)  # disabled
move = Move(Geometry=construct_point_2, Motion=unit_z)  # -> Geometry, Transform; disabled
rectangle = Rectangle(Plane=xy_plane_2, XSize=number_slider_5, YSize=number_slider_4, Radius=0)  # -> Rectangle, Length; disabled
panel_8 = Panel(planar_grid_2)

# ----
# Alternate Geometry
human_drawn_curve = Curve(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)
boundary_surfaces = BoundarySurfaces(Edges=human_drawn_curve)
move_2 = Move(Geometry=boundary_surfaces, Motion=planar_grid_2)  # -> Geometry, Transform

panel_9 = Panel(planar_grid)
xy_plane_3 = XYPlane(Origin=Point(0, 0, 0))  # disabled
unit_x_2 = UnitX(Factor=1)  # disabled
unit_y_2 = UnitY(Factor=1)  # disabled
distance = Distance(PointA=planar_grid_2, PointB=construct_point)
number_slider_6 = Slider(25, range=0..100)  # disabled
rectangle_2 = Rectangle(Plane=planar_grid, XSize=Slider(2, range=1..20), YSize=Slider(2, range=1..20), Radius=0)  # -> Rectangle, Length
curve = Curve(rectangle.Rectangle)  # disabled
number_slider_7 = Slider(14, range=0..100)
rectangle_3 = Rectangle(Plane=planar_grid_2, XSize=Slider(4, range=1..20), YSize=Slider(3, range=1..20), Radius=0)  # -> Rectangle, Length
annotation_dot = AnnotationDot(Location=move.Geometry, PrimaryText=panel_6)  # -> AnnotationDot, Location, PrimaryText, TextHeight; disabled
planar_grid_3 = PlanarGrid(BasePoint=xy_plane_3, IDir=unit_y_2, JDir=unit_x_2, IDistance=panel_4, JDistance=panel_2, INumber=panel_3, JNumber=panel)  # disabled
panel_10 = Panel(distance)
multiplication_5 = Multiplication(A=distance, B=Slider(1.1, range=0..3))
panel_11 = Panel(curve)  # disabled
unit_z_2 = UnitZ(Factor=number_slider_6)  # disabled
boundary_surfaces_2 = BoundarySurfaces(Edges=curve)  # disabled
unit_z_3 = UnitZ(Factor=Slider(14, range=0..100))
panel_12 = Panel(rectangle_3.Rectangle)

# ----
# Alternate Geometry
human_drawn_curve_2 = Curve(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)  # disabled
boundary_surfaces_3 = BoundarySurfaces(Edges=human_drawn_curve_2)  # disabled
move_3 = Move(Geometry=boundary_surfaces_3, Motion=planar_grid_3)  # -> Geometry, Transform; disabled

panel_13 = Panel(rectangle_2.Rectangle)
boundary_surfaces_4 = BoundarySurfaces(Edges=rectangle_3.Rectangle)
boundary_surfaces_5 = BoundarySurfaces(Edges=rectangle_2.Rectangle)
number_slider_8 = Slider(1.3, range=0..3)  # disabled
distance_2 = Distance(PointA=planar_grid_3, PointB=construct_point_2)  # disabled
extrude = Extrude(Base=boundary_surfaces_2, Direction=unit_z_2)  # disabled
unit_z_4 = UnitZ(Factor=multiplication_5)
rectangle_4 = Rectangle(Plane=planar_grid_3, XSize=columnx, YSize=columny, Radius=0)  # -> Rectangle, Length; disabled
surface = Surface(boundary_surfaces_4)
panel_14 = Panel(distance_2)  # disabled
extrude_2 = Extrude(Base=boundary_surfaces_5, Direction=unit_z_3)
multiplication_6 = Multiplication(A=distance_2, B=number_slider_8)  # -> flatten(Result); disabled
panel_15 = Panel(rectangle_4.Rectangle)  # disabled
extrude_3 = Extrude(Base=surface, Direction=unit_z_4)  # -> flatten(Extrusion)

# ----
# Add Plinth
surface_2 = Surface(flatten(surface))
bounding_box = BoundingBox(Content=surface_2, Plane=PlaneXY(0, 0, 0), UnionBox=True)  # -> Box, Box_2
unit_z_5 = UnitZ(Factor="-2")
extrude_4 = Extrude(Base=bounding_box.Box, Direction=unit_z_5)
merge = Merge(Data1=extrude_3, Data2=extrude_4)  # -> flatten(Result)
solid_union = SolidUnion(Breps=merge)

boundary_surfaces_6 = BoundarySurfaces(Edges=rectangle_4.Rectangle)  # -> flatten(Surfaces); disabled
unit_z_6 = UnitZ(Factor=multiplication_6)  # disabled
surface_3 = Surface(flatten(boundary_surfaces_6))  # disabled
extrude_5 = Extrude(Base=surface_3, Direction=unit_z_6)  # disabled
cluster = Cluster(surface=surface_3, d1=extrude_5)  # disabled

# ==== cluster Cluster
d1 = ClusterInput()
surface = ClusterInput()

# ----
# Add Plinth
surface_2 = Surface(flatten(surface))  # disabled
panel = Panel("-2")  # disabled
bounding_box = BoundingBox(Content=surface_2, Plane=PlaneXY(0, 0, 0), UnionBox=True)  # -> Box, Box_2; disabled
unit_z = UnitZ(Factor=panel)  # disabled
extrude = Extrude(Base=bounding_box.Box, Direction=unit_z)  # disabled
merge = Merge(Data1=d1, Data2=extrude)  # -> flatten(Result); disabled
solid_union = SolidUnion(Breps=merge)  # disabled
